# Grasshopper definition barrel_vault.gh (Grasshopper 1.0.7)
# plug-ins: Anemone

image = ImageSampler(
    FilePath="C:\Users\prova\Downloads\botte.png",
    Filter="Colour",
    Interpolate=False,
    Umax=1,
    Umin=0,
    Vmax=1,
    Vmin=0,
    Wrap=1)
panel = Panel("2")
B = Panel("0.9")
max_loop = Panel("100000")
step_b = Panel("0.1")
loop_start = LoopStart(N=max_loop, T=Button(), D0=panel, D1=B)  # -> port, Counter, Data, Data_2
addition = Addition(A=loop_start.Data_2, B=step_b)
panel_2 = Panel(loop_start.Counter)
limit_b = Panel("5")
larger = LargerThan(FirstNumber=addition, SecondNumber=limit_b)  # -> LargerThan, OrEqualTo
bool = Boolean(larger.OrEqualTo)
division = Division(A=bool, B=10)
filter = StreamFilter(Gate=larger.OrEqualTo, Stream0=addition, Stream1=B)
addition_2 = Addition(A=loop_start.Data, B=division)
xz = XZPlane(Origin=Point(0, 0, 0))
Y = UnitY(Factor=filter)
arc = Arc(Plane=xz, Radius=expr("x/2", addition_2), Angle=Domain(0, 3.141592654))  # -> Arc, Length
extr = Extrude(Base=arc.Arc, Direction=Y)
limit_a = Panel("5")
larger_2 = LargerThan(FirstNumber=addition_2, SecondNumber=limit_a)  # -> LargerThan, OrEqualTo
point_on_mq = Panel("100")
area = Area(Geometry=extr)  # -> Area, Centroid
multiplication = Multiplication(A=area.Area, B=point_on_mq)
loop_end = LoopEnd(
    port=loop_start.port,
    Exit=larger_2.LargerThan,
    Data=addition_2,
    Data_2=filter,
    TimeOutVal=0,
    pausedState=False,
    state="Constant & Record")  # -> D0, D1
popgeo = PopulateGeometry(Geometry=extr, Count=multiplication, Seed=1)
panel_3 = Panel("Y:\JOB\JOB_2020\volte_ancona\ok\repository\barrel\Barrel_vault_")
panel_4 = Panel(loop_end.D0)
concat = Concatenate(FragmentA=panel_3, FragmentB=addition_2)
concat_2 = Concatenate(FragmentA=concat, FragmentB="_")
concat_3 = Concatenate(FragmentA=filter, FragmentB="_")
concat_4 = Concatenate(FragmentA=concat_2, FragmentB=concat_3)
concat_5 = Concatenate(FragmentA=concat_4, FragmentB=".csv")

# ---- group: Step 1: Flatten your points!
pts_input = Point(flatten(popgeo))

# ---- group: Step 3. Set the toggle into 'TRUE'
toggle = BooleanToggle(True)

# ---- group: Use this for export into csv
c_script = CSharpScript(pts=pts_input, filePath=concat_5, run=toggle)  # -> out, A; inputs pts: list of Point3d, filePath: String, run: Boolean
# ---------- c_script: C# ----------
    Component.Message = "Points3D into CSV";
    if (run)
    {
      string[] lines = new string[pts.Count];
      for (int i = 0; i < lines.Length; i++)
      {
        lines[i] = string.Format("{0},{1},{2}", pts[i].X, pts[i].Y, pts[i].Z);

      }
      System.IO.File.WriteAllText(filePath, string.Join(Environment.NewLine, lines), System.Text.Encoding.UTF8);
    }
# ---------- end c_script ----------
