# Grasshopper definition cloister_vault.gh (Grasshopper 1.0.7)
# plug-ins: Pufferfish, Anemone

image = ImageSampler(
    FilePath="C:\Users\prova\Downloads\padiglione.png",
    Filter="Colour",
    Interpolate=False,
    Umax=1,
    Umin=0,
    Vmax=1,
    Vmin=0,
    Wrap=1)
xz = XZPlane(Origin=Point(0, 0, 0))
panel = Panel("0.95")
B = Panel("1.9")
loop = Panel("100000")
step = Panel("0.1")
loop_start = LoopStart(N=loop, T=Button(), D0=panel, D1=B)  # -> port, Counter, Data, Data_2
panel_2 = Panel(loop_start.Counter)
addition = Addition(A=loop_start.Data_2, B=step)
panel_3 = Panel(addition)
Y = UnitY(Factor=panel_3)
limit_a = Panel("5")
limit_b = Panel("5")
larger = LargerThan(FirstNumber=addition, SecondNumber=limit_b)  # -> LargerThan, OrEqualTo
xz_2 = XZPlane(Origin=Point(0, 0, 0))
bool = Boolean(larger.OrEqualTo)
Y_2 = UnitY(Factor=panel_3)
division = Division(A=bool, B=20)
addition_2 = Addition(A=loop_start.Data, B=division)
panel_4 = Panel(addition_2)
arc = Arc(Plane=xz, Radius=panel_4, Angle=Domain(0, 3.141592654))  # -> Arc, Length
multiplication = Multiplication(A=panel_4, B=2)
extr = Extrude(Base=arc.Arc, Direction=Y)
end = EndPoints(Curve=arc.Arc)  # -> Start, End
vec = VectorXYZ(XComponent=0, YComponent=panel_4, ZComponent=0)  # -> Vector, Length
larger_2 = LargerThan(FirstNumber=multiplication, SecondNumber=limit_a)  # -> LargerThan, OrEqualTo
pt = Point(vec.Vector)
ln = Line(StartPoint=end.Start, EndPoint=pt)
ln_2 = Line(StartPoint=end.End, EndPoint=pt)
merge = Merge(Data1=ln, Data2=ln_2)
mirror = Mirror(Geometry=merge, Plane=xz_2)  # -> Geometry, Transform
project = Project(Curve=merge, Brep=extr, Direction=Vector(0, 0, 1))  # -> flatten(Curve)
move = Move(Geometry=mirror.Geometry, Motion=Y_2)  # -> Geometry, Transform
multiplication_2 = Multiplication(A=addition_2, B=2)
filter = StreamFilter(Gate=larger.OrEqualTo, Stream0=addition, Stream1=multiplication_2)
project_2 = Project(Curve=move.Geometry, Brep=extr, Direction=Vector(0, 0, 1))  # -> flatten(Curve)
loop_end = LoopEnd(
    port=loop_start.port,
    Exit=larger_2.LargerThan,
    Data=addition_2,
    Data_2=filter,
    TimeOutVal=0,
    pausedState=False,
    state="Constant output")  # -> D0, D1
panel_5 = Panel(loop_end.D0)
loft = Loft(Curves=project, Options={Adjust=False, Closed=False, LoftEnds=0, LoftSimp=0, LoftType=0, Rebuild=10, Refit=0.01})
loft_2 = Loft(Curves=project_2, Options={Adjust=False, Closed=False, LoftEnds=0, LoftSimp=0, LoftType=0, Rebuild=10, Refit=0.01})
item = ListItem(List=project, Index=0, Wrap=True)
item_2 = ListItem(List=project_2, Index=0, Wrap=True)
item_3 = ListItem(List=project, Index=1, Wrap=True)
merge_2 = Merge(Data1=item, Data2=item_2)

concat = Concatenate(FragmentA="Y:\JOB\JOB_2020\volte_ancona\ok\repository\cloister\", FragmentB="cloister_")
concat_2 = Concatenate(FragmentA=concat, FragmentB=multiplication)
concat_3 = Concatenate(FragmentA=concat_2, FragmentB="_")
concat_4 = Concatenate(FragmentA=concat_3, FragmentB=addition)
concat_5 = Concatenate(FragmentA=concat_4, FragmentB=".csv")

item_4 = ListItem(List=project_2, Index=1, Wrap=True)
loft_3 = Loft(Curves=merge_2, Options={Adjust=False, Closed=False, LoftEnds=0, LoftSimp=0, LoftType=0, Rebuild=10, Refit=0.01})
merge_3 = Merge(Data1=item_3, Data2=item_4)
loft_4 = Loft(Curves=merge_3, Options={Adjust=False, Closed=False, LoftEnds=0, LoftSimp=0, LoftType=0, Rebuild=10, Refit=0.01})
merge_4 = Merge(Data1=loft_3, Data2=loft_4, Data3=loft, Data4=loft_2)
join = BrepJoin(Breps=merge_4)  # -> Breps, Closed
point_mq = Panel("100")
area = Area(Geometry=join.Breps)  # -> Area, Centroid
multiplication_3 = Multiplication(A=area.Area, B=point_mq)
popgeo = PopulateGeometry(Geometry=join.Breps, Count=multiplication_3, Seed=1)  # -> flatten(Population)
pdecon = Deconstruct(Point=popgeo)  # -> XComponent, YComponent, ZComponent
roundd = RoundToDecimalPlace(NumberX=pdecon.XComponent, DecimalPlace=3, RoundType=0)  # -> Rounded, Difference
roundd_2 = RoundToDecimalPlace(NumberX=pdecon.YComponent, DecimalPlace=3, RoundType=0)  # -> Rounded, Difference
roundd_3 = RoundToDecimalPlace(NumberX=pdecon.ZComponent, DecimalPlace=3, RoundType=0)  # -> Rounded, Difference
pt_2 = ConstructPoint(XCoordinate=roundd.Rounded, YCoordinate=roundd_2.Rounded, ZCoordinate=roundd_3.Rounded)

# ---- group: Step 1: Flatten your points!
pts_input = Point(flatten(pt_2))

# ---- group: Step 3. Set the toggle into 'TRUE'
toggle = BooleanToggle(True)

# ---- group: Use this for export into csv
c_script = CSharpScript(pts=pts_input, filePath=concat_5, run=toggle)  # -> out, A; inputs pts: list of Point3d, filePath: String, run: Boolean
# ---------- c_script: C# ----------
    Component.Message = "Points3D into CSV";
    if (run)
    {
      string[] lines = new string[pts.Count];
      for (int i = 0; i < lines.Length; i++)
      {
        lines[i] = string.Format("{0},{1},{2}", pts[i].X, pts[i].Y, pts[i].Z);

      }
      System.IO.File.WriteAllText(filePath, string.Join(Environment.NewLine, lines), System.Text.Encoding.UTF8);
    }
# ---------- end c_script ----------
