# Grasshopper definition groined_vault.gh (Grasshopper 1.0.7)
# plug-ins: Pufferfish, Anemone

image = ImageSampler(
    FilePath="C:\Users\prova\Downloads\crociera.png",
    Filter="Colour",
    Interpolate=False,
    Umax=1,
    Umin=0,
    Vmax=1,
    Vmin=0,
    Wrap=1)
loop = Panel("10000000")
xz = XZPlane(Origin=Point(0, 0, 0))
panel = Panel("1")
panel_2 = Panel("0.9")
step = Panel(".05")
loop_start = LoopStart(N=loop, T=Button(), D0=panel, D1=panel_2)  # -> port, Counter, Data, Data_2
addition = Addition(A=loop_start.Data_2, B=step)
panel_3 = Panel(loop_start.Counter)
limit_a = Panel("5")
limit_b_2 = Panel("2.5")
larger = LargerThan(FirstNumber=addition, SecondNumber=limit_b_2)  # -> LargerThan, OrEqualTo
bool = Boolean(larger.OrEqualTo)
division = Division(A=bool, B=20)
filter = StreamFilter(Gate=larger.OrEqualTo, Stream0=addition, Stream1=panel_2)
panel_4 = Panel(filter)
Y = UnitY(Factor=expr("x*2", panel_4))
planesrf = PlaneSurface(Plane=PlaneXY(0, 0, 0), XSize=Domain(-10, 10), YSize=Domain(-10, 10))
addition_2 = Addition(A=loop_start.Data, B=division)
panel_5 = Panel(addition_2)
arc = Arc(Plane=xz, Radius=panel_5, Angle=Domain(0, 3.141592654))  # -> Arc, Length
end = EndPoints(Curve=arc.Arc)  # -> Start, End
move = Move(Geometry=end.Start, Motion=Y)  # -> Geometry, Transform
ln = Line(StartPoint=end.Start, EndPoint=move.Geometry)
len = Length(Curve=ln)
larger_2 = LargerThan(FirstNumber=expr("2*x", addition_2), SecondNumber=limit_a)  # -> LargerThan, OrEqualTo
midpt = CurveMiddle(Curve=ln)
ellipse = Ellipse(Plane=midpt, Radius1=panel_5, Radius2=expr("x/2", len))  # -> Ellipse, Focus1, Focus2
rotax = RotateAxis(Geometry=ellipse.Ellipse, Angle=1.570796327, Axis=ln)  # -> Geometry, Transform
panel_6 = Panel(addition_2)
split = SplitWithBrep(Curve=rotax.Geometry, Brep=planesrf)  # -> Curve, Points
Y_2 = UnitY(Factor=panel_4)
loop_end = LoopEnd(
    port=loop_start.port,
    Exit=larger_2.LargerThan,
    Data=addition_2,
    Data_2=filter,
    TimeOutVal=0,
    pausedState=False,
    state="Constant & Record")  # -> D0, D1
item = ListItem(List=split.Curve, Index=0, Wrap=True)
X = UnitX(Factor=panel_5)
extr = Extrude(Base=arc.Arc, Direction=expr("2*x", Y_2))
panel_7 = Panel(loop_end.D0)
extr_2 = Extrude(Base=item, Direction=expr("-2*x", X))
splitmul = SplitBrepMultiple(Brep=extr_2, Cutters=extr)
splitmul_2 = SplitBrepMultiple(Brep=extr, Cutters=extr_2)
item_2 = ListItem(List=splitmul_2, Index=[0, 1], Wrap=True)
item_3 = ListItem(List=splitmul, Index=[0, 1], Wrap=True)
multiplication = Multiplication(A=addition_2, B=2)
multiplication_2 = Multiplication(A=filter, B=2)
merge = Merge(Data1=item_2, Data2=item_3)
panel_8 = Panel("Y:\JOB\JOB_2020\volte_ancona\ok\repository\groined\groined_")
join = BrepJoin(Breps=merge)  # -> Breps, Closed
points_mq = Panel("100")
area = Area(Geometry=join.Breps)  # -> Area, Centroid
concat = Concatenate(FragmentA=panel_8, FragmentB=multiplication)
multiplication_3 = Multiplication(A=area.Area, B=points_mq)
popgeo = PopulateGeometry(Geometry=join.Breps, Count=multiplication_3, Seed=1)
concat_2 = Concatenate(FragmentA=concat, FragmentB="_")
pdecon = Deconstruct(Point=popgeo)  # -> XComponent, YComponent, ZComponent
concat_3 = Concatenate(FragmentA=concat_2, FragmentB=multiplication_2)
concat_4 = Concatenate(FragmentA=concat_3, FragmentB=".csv")
roundd = RoundToDecimalPlace(NumberX=pdecon.XComponent, DecimalPlace=3, RoundType=0)  # -> Rounded, Difference
roundd_2 = RoundToDecimalPlace(NumberX=pdecon.YComponent, DecimalPlace=3, RoundType=0)  # -> Rounded, Difference
roundd_3 = RoundToDecimalPlace(NumberX=pdecon.ZComponent, DecimalPlace=3, RoundType=0)  # -> Rounded, Difference
pt = ConstructPoint(XCoordinate=roundd.Rounded, YCoordinate=roundd_2.Rounded, ZCoordinate=roundd_3.Rounded)

# ---- group: Step 1: Flatten your points!
pts_input = Point(flatten(pt))

# ---- group: Step 3. Set the toggle into 'TRUE'
toggle = BooleanToggle(True)

# ---- group: Use this for export into csv
c_script = CSharpScript(pts=pts_input, filePath=concat_4, run=toggle)  # -> out, A; inputs pts: list of Point3d, filePath: String, run: Boolean
# ---------- c_script: C# ----------
    Component.Message = "Points3D into CSV";
    if (run)
    {
      string[] lines = new string[pts.Count];
      for (int i = 0; i < lines.Length; i++)
      {
        lines[i] = string.Format("{0},{1},{2}", pts[i].X, pts[i].Y, pts[i].Z);

      }
      System.IO.File.WriteAllText(filePath, string.Join(Environment.NewLine, lines), System.Text.Encoding.UTF8);
    }
# ---------- end c_script ----------
