# Grasshopper definition mirror_vault.gh (Grasshopper 1.0.7)
# plug-ins: Pufferfish, Anemone

step = Panel("0.1")
image = ImageSampler(
    FilePath="C:\Users\prova\Downloads\padiglione.png",
    Filter="Colour",
    Interpolate=False,
    Umax=829,
    Umin=1,
    Vmax=564,
    Vmin=1,
    Wrap=1)
xz = XZPlane(Origin=Point(0, 0, 0))
panel = Panel("0.95")
panel_2 = Panel("0.95")
B = Panel("1.9")
loop = Panel("100000000")
loop_start = LoopStart(N=loop, T=Button(), D0=panel_2, D1=B, D2=panel)  # -> port, Counter, Data, Data_2, Data_3
addition = Addition(A=loop_start.Data_3, B=step)
larger = LargerThan(FirstNumber=addition, SecondNumber=loop_start.Data)  # -> LargerThan, OrEqualTo
division = Division(A=loop_start.Data, B=2)
filter = StreamFilter(Gate=larger.OrEqualTo, Stream0=addition, Stream1=division)
bool = Boolean(larger.OrEqualTo)
division_2 = Division(A=bool, B=20)
step_2 = Panel(division_2)
panel_3 = Panel(loop_start.Counter)
addition_2 = Addition(A=loop_start.Data_2, B=step_2)
panel_4 = Panel(addition_2)
Y = UnitY(Factor=panel_4)
limit_a = Panel("5")
limit_b = Panel("5")
larger_2 = LargerThan(FirstNumber=addition_2, SecondNumber=limit_b)  # -> LargerThan, OrEqualTo
xz_2 = XZPlane(Origin=Point(0, 0, 0))
bool_2 = Boolean(larger_2.OrEqualTo)
Y_2 = UnitY(Factor=panel_4)
division_3 = Division(A=bool_2, B=20)
addition_3 = Addition(A=loop_start.Data, B=division_3)
panel_5 = Panel(addition_3)
arc = Arc(Plane=xz, Radius=panel_5, Angle=Domain(0, 3.141592654))  # -> Arc, Length
multiplication = Multiplication(A=panel_5, B=2)
extr = Extrude(Base=arc.Arc, Direction=Y)
end = EndPoints(Curve=arc.Arc)  # -> Start, End
vec = VectorXYZ(XComponent=0, YComponent=panel_5, ZComponent=0)  # -> Vector, Length
larger_3 = LargerThan(FirstNumber=multiplication, SecondNumber=limit_a)  # -> LargerThan, OrEqualTo
pt = Point(vec.Vector)
ln = Line(StartPoint=end.Start, EndPoint=pt)
ln_2 = Line(StartPoint=end.End, EndPoint=pt)
merge = Merge(Data1=ln, Data2=ln_2)
mirror = Mirror(Geometry=merge, Plane=xz_2)  # -> Geometry, Transform
project = Project(Curve=merge, Brep=extr, Direction=Vector(0, 0, 1))  # -> flatten(Curve)
multiplication_2 = Multiplication(A=addition_3, B=2)
move = Move(Geometry=mirror.Geometry, Motion=Y_2)  # -> Geometry, Transform
filter_2 = StreamFilter(Gate=larger_2.OrEqualTo, Stream0=addition_2, Stream1=multiplication_2)
project_2 = Project(Curve=move.Geometry, Brep=extr, Direction=Vector(0, 0, 1))  # -> flatten(Curve)
loop_end = LoopEnd(
    port=loop_start.port,
    Exit=larger_3.LargerThan,
    Data=addition_3,
    Data_2=filter_2,
    Data_3=filter,
    TimeOutVal=0,
    pausedState=False,
    state="Constant output")  # -> D0, D1, D2
loft = Loft(Curves=project, Options={Adjust=False, Closed=False, LoftEnds=0, LoftSimp=0, LoftType=0, Rebuild=10, Refit=0.01})
loft_2 = Loft(Curves=project_2, Options={Adjust=False, Closed=False, LoftEnds=0, LoftSimp=0, LoftType=0, Rebuild=10, Refit=0.01})
item = ListItem(List=project, Index=0, Wrap=True)
item_2 = ListItem(List=project_2, Index=0, Wrap=True)
item_3 = ListItem(List=project, Index=1, Wrap=True)
merge_2 = Merge(Data1=item, Data2=item_2)
item_4 = ListItem(List=project_2, Index=1, Wrap=True)
loft_3 = Loft(Curves=merge_2, Options={Adjust=False, Closed=False, LoftEnds=0, LoftSimp=0, LoftType=0, Rebuild=10, Refit=0.01})
merge_3 = Merge(Data1=item_3, Data2=item_4)
Z = UnitZ(Factor=filter)
loft_4 = Loft(Curves=merge_3, Options={Adjust=False, Closed=False, LoftEnds=0, LoftSimp=0, LoftType=0, Rebuild=10, Refit=0.01})
merge_4 = Merge(Data1=loft_3, Data2=loft_4, Data3=loft, Data4=loft_2)
point_mq = Panel("100")
join = BrepJoin(Breps=merge_4)  # -> Breps, Closed
planesrf = PlaneSurface(Plane=PlaneXY(0, 0, 0), XSize=Domain(-10, 10), YSize=Domain(-10, 10))

# ---- group: Step 3. Set the toggle into 'TRUE'
toggle = BooleanToggle(True)

# ----
move_2 = Move(Geometry=planesrf, Motion=Z)  # -> Geometry, Transform
bbx = BrepBrep(BrepA=join.Breps, BrepB=move_2.Geometry)  # -> Curves, Points
boundary = BoundarySurfaces(Edges=bbx.Curves)
split = SplitBrep(Brep=join.Breps, Cutter=move_2.Geometry)
item_5 = ListItem(List=split, Index=1, Wrap=True)
merge_5 = Merge(Data1=boundary, Data2=item_5)
join_2 = BrepJoin(Breps=merge_5)  # -> Breps, Closed
area = Area(Geometry=join_2.Breps)  # -> Area, Centroid
multiplication_3 = Multiplication(A=area.Area, B=point_mq)
popgeo = PopulateGeometry(Geometry=join_2.Breps, Count=multiplication_3, Seed=1)  # -> flatten(Population)
pdecon = Deconstruct(Point=popgeo)  # -> XComponent, YComponent, ZComponent
roundd = RoundToDecimalPlace(NumberX=pdecon.XComponent, DecimalPlace=3, RoundType=0)  # -> Rounded, Difference
roundd_2 = RoundToDecimalPlace(NumberX=pdecon.YComponent, DecimalPlace=3, RoundType=0)  # -> Rounded, Difference
roundd_3 = RoundToDecimalPlace(NumberX=pdecon.ZComponent, DecimalPlace=3, RoundType=0)  # -> Rounded, Difference
pt_2 = ConstructPoint(XCoordinate=roundd.Rounded, YCoordinate=roundd_2.Rounded, ZCoordinate=roundd_3.Rounded)

# ---- group: Step 1: Flatten your points!
pts_input = Point(flatten(pt_2))

# ----
concat = Concatenate(FragmentA="Y:\JOB\JOB_2020\volte_ancona\ok\repository\mirror\", FragmentB="mirror_")
concat_2 = Concatenate(FragmentA=concat, FragmentB=multiplication)
concat_3 = Concatenate(FragmentA=concat_2, FragmentB="_")
concat_4 = Concatenate(FragmentA=concat_3, FragmentB=addition_2)

concat_5 = Concatenate(FragmentA=concat_4, FragmentB="_")
concat_6 = Concatenate(FragmentA=concat_5, FragmentB=filter)

concat_7 = Concatenate(FragmentA=concat_6, FragmentB=".csv")

# ---- group: Use this for export into csv
c_script = CSharpScript(pts=pts_input, filePath=concat_7, run=toggle)  # -> out, A; inputs pts: list of Point3d, filePath: String, run: Boolean
# ---------- c_script: C# ----------
    Component.Message = "Points3D into CSV";
    if (run)
    {
      string[] lines = new string[pts.Count];
      for (int i = 0; i < lines.Length; i++)
      {
        lines[i] = string.Format("{0},{1},{2}", pts[i].X, pts[i].Y, pts[i].Z);

      }
      System.IO.File.WriteAllText(filePath, string.Join(Environment.NewLine, lines), System.Text.Encoding.UTF8);
    }
# ---------- end c_script ----------
