# Grasshopper definition sail_vault.gh (Grasshopper 1.0.7)
# plug-ins: Pufferfish, Anemone

loop = Panel("10000000")
A = Panel("1.9")
panel = Panel("2")
loop_start = LoopStart(N=loop, T=Button(), D0=A, D1=panel)  # -> port, Counter, Data, Data_2
step = Panel("0.1")
addition = Addition(A=loop_start.Data, B=step)
limit_b = Panel("5")
limit_a = Panel("5")
step_2 = Panel("0.1")
larger = LargerThan(FirstNumber=addition, SecondNumber=limit_b)  # -> LargerThan, OrEqualTo
filter = StreamFilter(Gate=larger.OrEqualTo, Stream0=0, Stream1=step_2)
addition_2 = Addition(A=loop_start.Data_2, B=filter)

points_mq = Panel("100")
planesrf = PlaneSurface(Plane=PlaneXY(0, 0, 0), XSize=Domain(-10, 10), YSize=Domain(-10, 10))
rectangle = Rectangle(Plane=PlaneXY(0, 0, 0), XSize=addition, YSize=addition_2, Radius=0)  # -> Rectangle, Length
cpoly = ControlPolygon(Curve=rectangle.Rectangle)  # -> Polygon, Points
item = ListItem(List=cpoly.Points, Index=1, Wrap=True)
item_2 = ListItem(List=cpoly.Points, Index=0, Wrap=True)
item_3 = ListItem(List=cpoly.Points, Index=2, Wrap=True)
item_4 = ListItem(List=cpoly.Points, Index=3, Wrap=True)
sph4pt = Sphere4Pt(Point1=item_2, Point2=item, Point3=item_3, Point4=item_4)  # -> Center, Radius, Sphere
split = SplitBrep(Brep=sph4pt.Sphere, Cutter=planesrf)
Z = UnitZ(Factor=sph4pt.Radius)
extr = Extrude(Base=rectangle.Rectangle, Direction=Z)
item_5 = ListItem(List=split, Index=0, Wrap=True)
split_2 = SplitBrep(Brep=item_5, Cutter=extr)
item_6 = ListItem(List=split_2, Index=0, Wrap=True)
area = Area(Geometry=item_6)  # -> Area, Centroid
multiplication = Multiplication(A=area.Area, B=points_mq)
popgeo = PopulateGeometry(Geometry=item_6, Count=multiplication, Seed=1)

larger_2 = LargerThan(FirstNumber=addition_2, SecondNumber=limit_a)  # -> LargerThan, OrEqualTo
filter_2 = StreamFilter(Gate=larger.OrEqualTo, Stream0=addition, Stream1=panel)
loop_end = LoopEnd(
    port=loop_start.port,
    Exit=larger_2.OrEqualTo,
    Data=filter_2,
    Data_2=addition_2,
    TimeOutVal=0,
    pausedState=False,
    state="Constant & Record")  # -> D0, D1
concat = Concatenate(FragmentA="Y:\JOB\JOB_2020\volte_ancona\ok\repository\sail\", FragmentB="sail_vault_")
concat_2 = Concatenate(FragmentA=concat, FragmentB=addition)
concat_3 = Concatenate(FragmentA=concat_2, FragmentB="_")
pdecon = Deconstruct(Point=popgeo)  # -> XComponent, YComponent, ZComponent
concat_4 = Concatenate(FragmentA=concat_3, FragmentB=addition_2)
roundd = RoundToDecimalPlace(NumberX=pdecon.XComponent, DecimalPlace=3, RoundType=0)  # -> Rounded, Difference
roundd_2 = RoundToDecimalPlace(NumberX=pdecon.YComponent, DecimalPlace=3, RoundType=0)  # -> Rounded, Difference
roundd_3 = RoundToDecimalPlace(NumberX=pdecon.ZComponent, DecimalPlace=3, RoundType=0)  # -> Rounded, Difference
concat_5 = Concatenate(FragmentA=concat_4, FragmentB=".csv")
pt = ConstructPoint(XCoordinate=roundd.Rounded, YCoordinate=roundd_2.Rounded, ZCoordinate=roundd_3.Rounded)

# ---- group: Step 1: Flatten your points!
pts_input = Point(flatten(pt))

# ---- group: Step 3. Set the toggle into 'TRUE'
toggle = BooleanToggle(True)

# ---- group: Use this for export into csv
c_script = CSharpScript(pts=pts_input, filePath=concat_5, run=toggle)  # -> out, A; inputs pts: list of Point3d, filePath: String, run: Boolean
# ---------- c_script: C# ----------
    Component.Message = "Points3D into CSV";
    if (run)
    {
      string[] lines = new string[pts.Count];
      for (int i = 0; i < lines.Length; i++)
      {
        lines[i] = string.Format("{0},{1},{2}", pts[i].X, pts[i].Y, pts[i].Z);

      }
      System.IO.File.WriteAllText(filePath, string.Join(Environment.NewLine, lines), System.Text.Encoding.UTF8);
    }
# ---------- end c_script ----------
